# Dynamo custom node Annotation BoundingBox.dyf (Dynamo 1.3.4.6666)
# category: GeniusLoci.Geometry
# Get the BoundingBox of the view specific element. (Text, tag, etc)

element = Input()
python_script = Python(IN[0]=element)
# ---------- python_script.python (26 lines) ----------
#Based on a kennyb6's script
import clr
clr.AddReference('ProtoGeometry')
from Autodesk.DesignScript.Geometry import *
clr.AddReference('RevitNodes')
import Revit
# Import DocumentManager
clr.AddReference('RevitServices')
import RevitServices
from RevitServices.Persistence import DocumentManager
doc = DocumentManager.Instance.CurrentDBDocument
clr.ImportExtensions(Revit.GeometryConversion)

annotations=UnwrapElement(IN[0])
if not hasattr(annotations, '__iter__'):
    annotations = [annotations]

bbox = []

for anno in annotations:
    viewId = anno.OwnerViewId
    view = doc.GetElement(viewId)
    bbox.append(anno.BoundingBox[view].ToProtoType())

if isinstance(IN[0], list): OUT = bbox
else: OUT = bbox[0]
# ----------------------------------------
BoundingBox = Output(python_script)
