# Dynamo custom node Convert from InternalOrigin CoordinateSystem.dyf (Dynamo 1.3.4.6666)
# category: GeniusLoci.Geometry
# Get the location point in the 3 coordinate systems : Shared Coordinates, Project Coordinates, Relative Origin Coordinates.
# Based on a Daniel Woodcock's script.

point = Input(point: Autodesk.DesignScript.Geometry.Point[])  # Point in Internal Origin System
python_script = Python(IN[0]=point)
# ---------- python_script.python (47 lines) ----------
import clr
clr.AddReference('RevitServices')
import RevitServices 
from RevitServices.Persistence import DocumentManager
doc = DocumentManager.Instance.CurrentDBDocument

clr.AddReference('RevitNodes')
import Revit
clr.ImportExtensions(Revit.GeometryConversion)

clr.AddReference('RevitAPI')
import Autodesk
from Autodesk.Revit.DB import FilteredElementCollector, BuiltInCategory

# Create a list object from singleton...
def tolist(obj1):
	if hasattr(obj1,"__iter__"): return obj1
	else: return [obj1]
	
# Convert Point from  Internal to Shared Coordinates...
def ToSharedCoordinates(pt):
	pt = doc.ActiveProjectLocation.GetTotalTransform().Inverse.OfPoint(pt).ToPoint()
	return pt

# Convert Point from Relative to Project Coordinates...
def ToProjectCoordinates(pt,pbp):
	pt = pt.Subtract(pbp).ToPoint()
	return pt

# Input Variables...
pts = tolist(IN[0])
# Output Variables...
shared, project, relative = [], [], []

# Collect Project Basepoint...
basePt = FilteredElementCollector(doc).OfCategory(BuiltInCategory.OST_ProjectBasePoint).FirstElement()
pbp = basePt.get_BoundingBox(None).Min

for pt in pts:
	# Convert point to Shared Coordinates...
	shared.append(ToSharedCoordinates(pt.ToXyz()))
	# Convert point to Project Coordinates...
	project.append(ToProjectCoordinates(pt.ToXyz(),pbp))
	# Point is already Relative to the Internal Origin...
	relative.append(pt)
     
OUT = shared, project, relative
# ----------------------------------------
code_block = CodeBlock(x=python_script) { x[0]; x[1]; x[2]; }
Point_Survey_System = Output(code_block.out0)  # "Point (Survey System)"
Point_Project_Base_Pt_System = Output(code_block.out1)  # "Point (Project Base Pt System)"
Point_Internal_Origin_System = Output(code_block.out2)  # "Point (Internal Origin System)"
