# Dynamo custom node Convert from SurveyPoint CoordinateSystem.dyf (Dynamo 1.3.4.6666)
# category: GeniusLoci.Geometry
# Convert from Survey Coordinate to Internal Origin Coordinate.

point = Input(point: Autodesk.DesignScript.Geometry.Point[]..[])  # Point in Survey Coordinate System
python_script = Python(IN[0]=point)
# ---------- python_script.python (17 lines) ----------
import clr
clr.AddReference('RevitServices')
import RevitServices
from RevitServices.Persistence import DocumentManager
doc = DocumentManager.Instance.CurrentDBDocument

clr.AddReference('RevitNodes')
import Revit
clr.ImportExtensions(Revit.GeometryConversion)

pts = [pt.ToXyz(True) for pt in IN[0]] if isinstance(IN[0],list) else [IN[0].ToXyz(True)]

#Translate point from Shared coordinates to Internal
translatedPoint = [doc.ActiveProjectLocation.GetTotalTransform().OfPoint(pt).ToPoint() for pt in pts]

if isinstance(IN[0], list): OUT = translatedPoint
else: OUT = translatedPoint[0]
# ----------------------------------------
Point = Output(python_script)  # Point in Internal Origin Coordinate System
