# Dynamo custom node Create Legend Component.dyf (Dynamo 1.3.4.6666)
# category: GeniusLoci.Element
# Inserts a new legend component by duplicating an existing in the given legend view.
# Please note : At least one legend component must be placed in the legend view.

view = Input()  # Legend view
familyType = Input(familyType:var[]..[])
translation = Input(translation: Autodesk.DesignScript.Geometry.Point[]..[])  # Point to use as translation relative to the component already placed
python_script = Python(IN[0]=view, IN[1]=familyType, IN[2]=translation)
# ---------- python_script.python (40 lines) ----------
#Oliwer Kulpa : https://thebuildingcoder.typepad.com/blog/2010/05/duplicate-legend-component.html
import clr
# Import RevitAPI Classes
clr.AddReference('RevitAPI')
import Autodesk
from Autodesk.Revit.DB import *

clr.AddReference("RevitNodes")
import Revit
clr.ImportExtensions(Revit.GeometryConversion)

# Import DocumentManager and TransactionManager
clr.AddReference("RevitServices")
import RevitServices
from RevitServices.Persistence import DocumentManager
from RevitServices.Transactions import TransactionManager

doc = DocumentManager.Instance.CurrentDBDocument

view = UnwrapElement(IN[0]) if isinstance(IN[0],list) else [UnwrapElement(IN[0])]
view=view[0]
family_types = UnwrapElement(IN[1]) if isinstance(IN[1],list) else [UnwrapElement(IN[1])]
translations = IN[2] if isinstance(IN[2],list) else [IN[2]]
output=[]

existing_legend_component = FilteredElementCollector(doc, view.Id).OfCategory(BuiltInCategory.OST_LegendComponents).FirstElement()

# Start Transaction
TransactionManager.Instance.EnsureInTransaction(doc)
for translation,family_type in zip(translations,family_types):
	# Copy legend and set new Id to represent new element
	new_legend_component = ElementTransformUtils.CopyElement(doc, existing_legend_component.Id,translation.ToRevitType())
	# Since result of CopyElement is a list of Ids, I need to fetch first element from copied elements
	doc.GetElement(new_legend_component[0]).get_Parameter(BuiltInParameter.LEGEND_COMPONENT).Set(family_type.Id)
	output.append(doc.GetElement(new_legend_component[0]))
doc.Regenerate()
# End Transaction
TransactionManager.Instance.TransactionTaskDone()

OUT=output
# ----------------------------------------
Legend_Component = Output(python_script)
