# Dynamo custom node Display Units.dyf (Dynamo 1.3.3.4651)
# category: GeniusLoci.Utilities
# Enumerate the UnitTypes and the UnitGroups and returns their DisplayUnitTypes and UnitSymbols associated.

display_units = Python()
# ---------- display_units.python (44 lines) ----------
#Alban de Chasteigner 2018
#twitter : @geniusloci_bim
#geniusloci.bim@gmail.com

import clr
clr.AddReference('ProtoGeometry')
from Autodesk.DesignScript.Geometry import *

# Import DocumentManager and TransactionManager
clr.AddReference("RevitServices")
import RevitServices
from RevitServices.Persistence import DocumentManager

# Import RevitAPI
clr.AddReference("RevitAPI")
import Autodesk
from Autodesk.Revit.DB import *
import System
from System.Collections.Generic import *

groups=[]
unitSymbTypes=[]
dispsyms=[]
dispunits=[]

units = UnitUtils.GetValidUnitTypes()
for unit in units :
	group=UnitUtils.GetUnitGroup(unit)
	groups.append(group)
	dispunit = UnitUtils.GetValidDisplayUnits(unit)
	dispunits.append(dispunit)
for dispuni in dispunits :
	for dispun in dispuni:
		unitSymbType=FormatOptions.GetValidUnitSymbols(dispun)
		unitSymbTypes.append(unitSymbType)
for unitsymbol in unitSymbTypes:
	for unitsymb in unitsymbol :
		if unitsymb == UnitSymbolType.UST_NONE:
			dispsym = None
		else:
			dispsym = LabelUtils.GetLabelFor(unitsymb)
		dispsyms.append(dispsym)
				
OUT = units, groups,dispunits,unitSymbTypes,dispsyms
# ----------------------------------------
code_block = CodeBlock(x=display_units) { x[0]; x[1]; x[2]; x[3]; x[4]; }
UnitType = Output(code_block.out0)
UnitGroup = Output(code_block.out1)
DisplayUnitType = Output(code_block.out2)
code_block_2 = CodeBlock(code_block.out4, code_block.out3, code_block.out2) { d = DSCore.List.Chop((DSCore.List.Chop(b, Count(a<1L>))), Count(c<1L>)); DSCore.List.Clean(d@@-2<1>, false); }
UnitSymbol = Output(code_block_2.out1)
