# Dynamo custom node Element Parameters Properties.dyf (Dynamo 1.3.4.6666)
# category: GeniusLoci.Parameter
# Retrieves all the properties of the parameters from a given element in the active or given document.

element = Input()
properties = Python(IN[0]=element)  # "ElementParameter.Properties"
# ---------- properties.python (64 lines) ----------
import clr
clr.AddReference('RevitAPI')
from Autodesk.Revit.DB import *

clr.AddReference('RevitNodes')
import Revit
clr.ImportExtensions(Revit.Elements)

clr.AddReference('RevitServices')
import RevitServices
from RevitServices.Persistence import DocumentManager
uiapp = DocumentManager.Instance.CurrentUIApplication
app = uiapp.Application
version=int(app.VersionNumber)

if isinstance(IN[0], list) : elements = UnwrapElement(IN[0])
else : elements = [UnwrapElement(IN[0])]

params= []

for elem in elements:
	doc=elem.Document
	params=elem.GetOrderedParameters()
	pname, guid, pgroup, ptype, visible, utype, dutype, stype,isshared,isreadonly, usermodifiable, hasvalue, value= [],[],[],[],[],[],[],[],[],[],[],[],[]
	datatype= []
	for param in params:
		pname.append(param.Definition.Name)
		try:guid.append(param.GUID)
		except: guid.append(None)
		pgroup.append(param.Definition.ParameterGroup)
		ptype.append(param.Definition.ParameterType)
		visible.append(param.Definition.Visible)
		if version < 2022:
			utype.append(param.Definition.UnitType)
			try: dutype.append(param.DisplayUnitType)
			except: dutype.append(None)
		else: 
			try:utype.append(UnitUtils.GetTypeCatalogStringForSpec(param.Definition.GetDataType()))
			except : utype.append(None)
			try: dutype.append(UnitUtils.GetTypeCatalogStringForUnit(param.GetUnitTypeId()))
			except: dutype.append(None)
		stype.append(param.StorageType)
		isshared.append(param.IsShared)
		hasvalue.append(param.HasValue)
		if param.StorageType == StorageType.ElementId :
			if param.AsElementId().IntegerValue >0:
				value.append(doc.GetElement(param.AsElementId()))
			else: 
				value.append(param.AsValueString())
		#elif param.StorageType == StorageType.Integer : 
		#	value.append(param.AsInteger())
		#elif param.StorageType == StorageType.Double : 
		#	value.append(param.AsDouble())
		else :
			val = param.AsValueString()
			if val == None :
				val2 = param.AsString()
				value.append(val2)
			else:
				value.append(val)
		isreadonly.append(param.IsReadOnly)
		usermodifiable.append(param.UserModifiable)
	
OUT = params, pname,guid,pgroup,ptype,utype,dutype,stype,visible,isshared,isreadonly,usermodifiable,hasvalue,value
# ----------------------------------------
code_block = CodeBlock(x=properties) { x[0]; x[1]; x[2]; x[3]; x[4]; x[5]; x[6]; x[7]; x[8]; x[9]; x[10]; x[11]; x[12]; x[13]; }
Parameter = Output(code_block.out0)
Name = Output(code_block.out1)
GUID = Output(code_block.out2)
Group = Output(code_block.out3)
Type = Output(code_block.out4)
UnitType = Output(code_block.out5)
DisplayUnitType = Output(code_block.out6)
StorageType = Output(code_block.out7)
IsVisible = Output(code_block.out8)
IsSharedParameter = Output(code_block.out9)
IsReadOnly = Output(code_block.out10)
IsUserModfiable = Output(code_block.out11)
HasValue = Output(code_block.out12)
Value = Output(code_block.out13)
