# Dynamo custom node Export PAT File.dyf (Dynamo 1.3.4.6666)
# category: GeniusLoci.FillPattern
# Exports as string a Fill Pattern Element in a .pat (pattern) file .

fillPatternElement = Input()
units = Input(units :string= "MM")  # Desired units : "MM" or "INCH"
filePath = Input()  # desired name+.pat
python_script = Python(IN[0]=fillPatternElement, IN[1]=units, IN[2]=filePath)
# ---------- python_script.python (43 lines) ----------
#Alban de Chasteigner 2020
#twitter : @geniusloci_bim
#geniusloci.bim@gmail.com

import clr
clr.AddReference('RevitAPI')
import Autodesk
from Autodesk.Revit.DB import *

import sys
sys.path.append(r'C:\Program Files (x86)\IronPython 2.7\Lib')
import codecs

fillPatterns = UnwrapElement(IN[0]) if isinstance(IN[0],list) else [UnwrapElement(IN[0])]
units=IN[1]
filePath = IN[2]
result,segments = [],[]

ut_degrees = DisplayUnitType.DUT_DECIMAL_DEGREES
if units == "MM":
	ut_units = DisplayUnitType.DUT_MILLIMETERS
else:
	ut_units = DisplayUnitType.DUT_DECIMAL_INCHES
	
for fillPattern in fillPatterns:
	UIunit = fillPattern.Document.GetUnits().GetFormatOptions(UnitType.UT_Length).DisplayUnits
	pattern=fillPattern.GetFillPattern()
	target=pattern.Target
	fillgrids=pattern.GetFillGrids()
	name=fillPattern.Name
	for fillG in fillgrids:
		result.append([UnitUtils.ConvertFromInternalUnits(fillG.Angle,ut_degrees),UnitUtils.ConvertFromInternalUnits(fillG.Origin.U,ut_units),UnitUtils.ConvertFromInternalUnits(fillG.Origin.V,ut_units),UnitUtils.ConvertFromInternalUnits(fillG.Shift,ut_units), UnitUtils.ConvertFromInternalUnits(fillG.Offset,ut_units)])
		segments.append([UnitUtils.ConvertFromInternalUnits(fill,ut_units) if fillG.GetSegments() else [None,None] for fill in fillG.GetSegments()])
		segments2=[[p*-1 if i%2 else p for i,p in enumerate(seg)] for seg in segments]
		output=list(map(lambda x, y:x + y, result, segments2))
		output2="\n".join(map(str, output))
		output3=output2.translate({ord(i): None for i in '[]'})
		final="\n"+";%UNITS="+units+"\n"+";%VERSION=3.0"+"\n"+"\n"+"*"+name+",exported by Dynamo"+"\n"+";%TYPE="+str(target).upper()+"\n"+output3

with codecs.open(filePath, 'w', encoding = 'UTF-8') as file:
	file.write(final)

OUT = final
# ----------------------------------------
Exported_string = Output(python_script)
