# Dynamo custom node FamilyInstance Reference ByRefLine.dyf (Dynamo 1.3.4.6666)
# category: GeniusLoci.Reference
# Works only in Revit 2018.1 and later.
# Gets the reference corresponding to the given Reference Line in the family instance.

familyInstance = Input()
ReferenceType = Input(ReferenceType:var=null)  # Default = StrongReference
python_script = Python(IN[0]=familyInstance, IN[1]=ReferenceType)
# ---------- python_script.python (20 lines) ----------
#Alban de Chasteigner 2018
#twitter : @geniusloci_bim
#geniusloci.bim@gmail.com

import clr

elements = UnwrapElement(IN[0]) if isinstance(IN[0],list) else [UnwrapElement(IN[0])]
reftype = UnwrapElement(IN[1])
ref=[]

#Get Reference Lines from Families
for element in elements:
	if reftype == None:
		reference = element.GetReferences(FamilyInstanceReferenceType.StrongReference)
	else :
		reference = element.GetReferences(reftype)
	ref.append(reference[0])

if isinstance(IN[0], list): OUT = ref
else: OUT = ref[0]
# ----------------------------------------
Reference = Output(python_script)
