# Dynamo custom node FamilyInstance Reference ByType.dyf (Dynamo 1.3.4.6666)
# category: GeniusLoci.Reference
# Works only in Revit 2018.1 and later.
# Gets the reference corresponding to the given Reference Plane in the family instance.
# Also works with linked family instance.

familyInstance = Input()
ReferenceType = Input(ReferenceType:var=null)  # Default = Center (Left/Right)
python_script = Python(IN[0]=familyInstance, IN[1]=ReferenceType)
# ---------- python_script.python (46 lines) ----------
#Alban de Chasteigner 2018
#twitter : @geniusloci_bim
#geniusloci.bim@gmail.com

import clr
clr.AddReference('RevitServices')
import RevitServices
from RevitServices.Persistence import DocumentManager
from RevitServices.Transactions import TransactionManager
doc = DocumentManager.Instance.CurrentDBDocument

clr.AddReference('RevitAPI')
import Autodesk
from Autodesk.Revit.DB import *

clr.AddReference('RevitNodes')
import Revit
clr.ImportExtensions(Revit.GeometryConversion)

elements = UnwrapElement(IN[0]) if isinstance(IN[0],list) else [UnwrapElement(IN[0])]
reftype = UnwrapElement(IN[1])
ref,refname,planeList=[],[],[]

#Get Reference Planes from Families
for element in elements:
	if reftype == None:
		reference = element.GetReferences(FamilyInstanceReferenceType.CenterLeftRight)
	else :
		reference = element.GetReferences(reftype)
	ref.append(reference[0])
	refname.append(element.GetReferenceName(reference[0]))
	try :
		TransactionManager.Instance.EnsureInTransaction(doc)
		trans1 = SubTransaction(doc)
		trans1.Start()
		sketch=SketchPlane.Create(doc,reference[0])
		plane = sketch.GetPlane().ToPlane(True)
		sketch.Dispose()
		trans1.RollBack()
		TransactionManager.Instance.TransactionTaskDone()
	except :
		plane=None
	planeList.append(plane)

if isinstance(IN[0], list): OUT = ref,refname,planeList
else: OUT = ref[0],refname[0],planeList[0]
# ----------------------------------------
code_block = CodeBlock(x=python_script) { x[0]; x[1]; x[2]; }
Reference = Output(code_block.out0)
ReferenceName = Output(code_block.out1)
Plane = Output(code_block.out2)
