# Dynamo custom node Import DWG.dyf (Dynamo 1.3.4.6666)
# category: GeniusLoci.CAD Import
# Import DWGs in views with options.
# Use with the Enumerate DWG import options node.
# Based on an archilab's script.

Filepaths = Input()
views = Input()  # As many Views as FilePaths
CustomScale = Input(CustomScale : double = 0)  # Attention : If this is defined, it takes preference over units
Colormode = Input()
Placement = Input()
Unit = Input()
python_script = Python(IN[0]=Filepaths, IN[1]=views, IN[2]=CustomScale, IN[3]=Colormode, IN[4]=Placement, IN[5]=Unit)
# ---------- python_script.python (51 lines) ----------
#Based on a Konrad Sobon script
#Additions by Alban de Chasteigner 2018
#Suggestion of Ryan Lenihan

import clr
# Import DocumentManager and TransactionManager
clr.AddReference('RevitServices')
import RevitServices
from RevitServices.Persistence import DocumentManager
from RevitServices.Transactions import TransactionManager
doc = DocumentManager.Instance.CurrentDBDocument

# Import RevitAPI
clr.AddReference('RevitAPI')
import Autodesk
from Autodesk.Revit.DB import *

filePaths = IN[0] if isinstance(IN[0],list) else [IN[0]]
views = UnwrapElement(IN[1]) if isinstance(IN[1],list) else [UnwrapElement(IN[1])]
customscale = IN[2]
colormode = IN[3]
placement = IN[4]
unit = IN[5]
viewsplaced,outName,CADlinktype,importinstance = [],[],[],[]

options = DWGImportOptions()
options.AutoCorrectAlmostVHLines = True
options.OrientToView = True
options.ThisViewOnly = True
options.VisibleLayersOnly = True
options.CustomScale = customscale
options.ColorMode = colormode
options.Placement= placement
options.Unit = unit

# Create ElementId / .NET object
linkedElem = clr.Reference[ElementId]()

for view in range(len(views)):
	TransactionManager.Instance.EnsureInTransaction(doc)
	doc.Import(filePaths[view], options, views[view], linkedElem)
	TransactionManager.Instance.TransactionTaskDone()
	viewsplaced.append(views[view])
	importinst = doc.GetElement(linkedElem.Value)
	importinstance.append(importinst)
	CADLink = doc.GetElement(importinst.GetTypeId())
	CADlinktype.append(CADLink)
	outName.append(Element.Name.GetValue(CADLink))
	
if isinstance(IN[0], list): OUT = viewsplaced,outName,CADlinktype,importinstance
else: OUT = viewsplaced[0],outName[0],CADlinktype[0],importinstance[0]
# ----------------------------------------
code_block = CodeBlock(x=python_script) { x[0]; x[1]; x[2]; x[3]; }
Views = Output(code_block.out0)
Name = Output(code_block.out1)
CADLinkType = Output(code_block.out2)
ImportInstance = Output(code_block.out3)
