# Dynamo custom node SelectByCategoryAndView.dyf (Dynamo 1.3.4.6666)
# category: GeniusLoci.Select
# Collects elements by Category and View in the active or given document.

view = Input(view:var[]..[] = Revit.Application.Document.Current.ActiveView)  # View of current or given document
category = Input()
selectByCategoryAndView = Python(IN[0]=view, IN[1]=category)
# ---------- selectByCategoryAndView.python (32 lines) ----------
#Alban de Chasteigner 2018
#twitter : @geniusloci_bim
#geniusloci.bim@gmail.com

import clr
clr.AddReference('RevitAPI')
import Autodesk
from Autodesk.Revit.DB import *
clr.AddReference('RevitServices')
import RevitServices
from RevitServices.Persistence import DocumentManager
clr.AddReference("RevitNodes")
import Revit
clr.ImportExtensions(Revit.GeometryConversion)

def tolist(x):
    if hasattr(x,'__iter__'): return x
    else : return [x]

views = tolist(UnwrapElement(IN[0]))
cats = tolist(UnwrapElement(IN[1]))

linkedEl,elements = [],[]
for view in views:
	doc=view.Document
	for cat in cats:
		collector = FilteredElementCollector(doc,view.Id).OfCategoryId(cat.Id).ToElements()
		linkedEl.append(collector)
	elements.append(linkedEl)

if not isinstance(IN[0], list) and not isinstance(IN[1], list): OUT = elements[0][0]
else: OUT = elements[0]
# ----------------------------------------
Elements = Output(selectByCategoryAndView)
